# Grasshopper definition 20240729.gh (Grasshopper 1.0.8)

construct_domain = ConstructDomain(DomainStart=Slider(19.816, range=0..100), DomainEnd=Slider(59.089, range=0..100))
point = Point([<point referenced from the Rhino model> x3])
list_length = ListLength(List=point)
random = Random(Range=construct_domain, Number=list_length, Seed=2)
graft_tree = GraftTree(Tree=random, IncludeEmptyLists=True, IncludeNullItems=True)
graft_tree_2 = GraftTree(Tree=point, IncludeEmptyLists=True, IncludeNullItems=True)

point_2 = Point(<point referenced from the Rhino model>)
sphere = Sphere(Base=point_2, Radius=Slider(71.986, range=0..100))
unit_z = UnitZ(Factor=Slider(53.098, range=0..100))
curve = Curve([<curve referenced from the Rhino model> x3])
extrude = Extrude(Base=curve, Direction=unit_z)
panel = Panel(curve)
loft = Loft(Curves=curve, Options={Adjust=False, Closed=False, LoftEnds=0, LoftSimp=0, LoftType=0, Rebuild=10, Refit=0.01})

circle_cnr = CircleCNR(Center=graft_tree_2, Normal=Vector(0, 0, 1), Radius=Slider(6, range=0..10))
circle_cnr_2 = CircleCNR(Center=graft_tree_2, Normal=Vector(0, 0, 1), Radius=graft_tree)
list_item = ListItem(Index=0, Wrap=True)
length = Length(Curve=circle_cnr_2)
panel_2 = Panel(list_item)
evaluate_curve = EvaluateCurve(Curve=reparameterize(circle_cnr_2), Parameter=[Slider(0.812, range=0..1), Slider(0.699, range=0..1)])  # -> Point, Tangent, Angle
line = Line(StartPoint=graft_tree_2, EndPoint=evaluate_curve.Point)
list_length_2 = ListLength(List=point)
trim_with_region = TrimWithRegion(Curve=line, Region=circle_cnr)  # -> Inside, Outside
curve_2 = Curve(trim_with_region.Outside)
random_2 = Random(Range="360", Number=list_length_2, Seed="54")
shift_paths = ShiftPaths(Data=curve_2, Offset="-1")
panel_3 = Panel(list_length_2)
graft_tree_3 = GraftTree(Tree=random_2, IncludeEmptyLists=True, IncludeNullItems=True)
rotate = Rotate(Geometry=shift_paths, Angle=degrees(graft_tree_3), Plane=graft_tree_2)  # -> Geometry, Transform
