# Grasshopper definition 20240805_Stairs.ghx (Grasshopper 1.0.8)

construct_domain = ConstructDomain(DomainStart="2", DomainEnd="11")
series = Series(Start="5", Step="5", Count="4")
range = Range(Domain=construct_domain, Steps="3")
shortest_list = ShortestList(ListA=series, ListB=range, TrimMode=2)  # -> ListA, ListB
construct_point = ConstructPoint(XCoordinate=shortest_list.ListA, YCoordinate=0, ZCoordinate=shortest_list.ListB)
unit_z = UnitZ(Factor="3")
panel = Panel("""0
1""")
move = Move(Geometry=construct_point, Motion=unit_z)  # -> Geometry, Transform
weave = Weave(Pattern=panel, Stream0=construct_point, Stream1=move.Geometry, NullGaps=False)
panel_2 = Panel(unit_z)
polyline = PolyLine(Vertices=weave, Closed=False)
point_order = PointOrder(Points=weave)
point_list = PointList(Points=weave, Size=Slider(0.443, range=0..2))
