# Grasshopper definition 20240805_Warren Truss.ghx (Grasshopper 1.0.8)

# ----
# make it produce even numbers for the truss to look like a truss
number_slider = Slider(14, range=0..20)

panel = Panel("top")
curve = Curve(<curve referenced from the Rhino model>)

panel_2 = Panel("bottom")
curve_2 = Curve(<curve referenced from the Rhino model>)

divide_curve = DivideCurve(Curve=curve_2, Count=number_slider, Kinks=False)  # -> Points, Tangents, Parameters
divide_curve_2 = DivideCurve(Curve=curve, Count=number_slider, Kinks=False)  # -> Points, Tangents, Parameters
panel_3 = Panel("""0
1""")
dispatch = Dispatch(List=divide_curve_2.Points, DispatchPattern=panel_3)  # -> ListA, ListB

# ----
# similar to weave but opposite.
# takes booleans (true or false, 0 or 1 where 0=false any other number is true)
# gives alternating points (B,A,B,A...)
dispatch_2 = Dispatch(List=divide_curve.Points, DispatchPattern=panel_3)  # -> ListA, ListB

# ----
# connect points from line A to x+1 of line B
panel_4 = Panel("""True 
False""")

# ----
# vertical lines between points
line = Line(StartPoint=divide_curve_2.Points, EndPoint=divide_curve.Points)

point = Point(dispatch.ListA)
point_2 = Point(dispatch_2.ListB)
boolean = Boolean(panel_4)

# ----
# 0 = false
# false = B
# false = stream 0
weave = Weave(Pattern=panel_3, Stream0=point_2, Stream1=point, NullGaps=False)

integer = Integer(boolean)
panel_5 = Panel(integer)
polyline = PolyLine(Vertices=weave, Closed=False)
