# Grasshopper definition 20240811_Iteration 1.gh (Grasshopper 1.0.8)

curve = Curve(<curve referenced from the Rhino model>)
construct_point = ConstructPoint(XCoordinate=0, YCoordinate=0, ZCoordinate=0)
point = Point(Point(-1.970660329, -49.79085095, 0))
division = Division(A=Slider(75, range=0..100), B=Slider(2, range=0..10))
point_2 = Point(construct_point)
circle = Circle(Plane=point, Radius=Slider(2, range=0..10))
offset_curve = OffsetCurve(Curve=curve, Distance=Slider(43, range=0..100), Corners=1)
unit_z = UnitZ(Factor=Slider(200, range=0..200))
circle_2 = Circle(Plane=point_2, Radius=division)
extrude = Extrude(Base=circle, Direction=unit_z)
divide_curve = DivideCurve(Curve=curve, Count=Slider(37, range=0..100), Kinks=False)  # -> Points, Tangents, Parameters
offset_curve_2 = OffsetCurve(Curve=circle_2, Distance=Slider(46, range=0..100), Corners=1)
unit_y = UnitY(Factor=1)
polyline = PolyLine(Vertices=divide_curve.Points, Closed=False)
radians = Radians(Degrees=Slider(360, range=0..360))
divide_curve_2 = DivideCurve(Curve=[circle_2, offset_curve_2], Count=Slider(35, range=0..100), Kinks=False)  # -> Points, Tangents, Parameters
polar_array = PolarArray(Geometry=extrude, Plane=unit_y, Count=Slider(18, range=0..100), Angle=radians)  # -> Geometry, Transform
polyline_2 = PolyLine(Vertices=divide_curve_2.Points, Closed=False)
