# Grasshopper definition 20240812_Spiral Stairs.gh (Grasshopper 1.0.8)

number_slider = Slider(702, range=0..5000)

panel = Panel("Division for landings")
division = Division(A=number_slider, B=Slider(12, range=0..20))

construct_domain = ConstructDomain(DomainStart=Slider(0, range=0..1), DomainEnd=number_slider)
construct_point = ConstructPoint(XCoordinate=Slider(1433, range=0..5000), YCoordinate=0, ZCoordinate=0)
range = Range(Domain=construct_domain, Steps=division)

# ----
# Surface revolve around axis
number_slider_2 = Slider(0, range=0..1)
radians = Radians(Degrees=Slider(307, range=0..360))
construct_domain_2 = ConstructDomain(DomainStart=number_slider_2, DomainEnd=radians)

number_slider_3 = Slider(742, range=0..5000)
number_slider_4 = Slider(306, range=0..5000)
construct_point_2 = ConstructPoint(XCoordinate=0, YCoordinate=0, ZCoordinate=0)
addition = Addition(A=number_slider_4, B=number_slider_3)
construct_point_3 = ConstructPoint(XCoordinate=number_slider_4, YCoordinate=0, ZCoordinate=0)
unit_x = UnitX(Factor=1)
construct_point_4 = ConstructPoint(XCoordinate=0, YCoordinate=0, ZCoordinate=0)
unit_z = UnitZ(Factor=1)
line_sdl = LineSDL(Start=construct_point_3, Direction=unit_x, Length=number_slider_3)
line_sdl_2 = LineSDL(Start=construct_point_4, Direction=unit_z, Length=1)
revolution = Revolution(Curve=line_sdl, Axis=line_sdl_2, Domain=construct_domain_2)

panel_2 = Panel("Inner circle")
circle_cnr = CircleCNR(Center=construct_point_2, Normal=Vector(0, 0, 1), Radius=number_slider_4)

panel_3 = Panel("Outer circle")
circle_cnr_2 = CircleCNR(Center=construct_point_2, Normal=Vector(0, 0, 1), Radius=addition)

xy_plane = XYPlane(Origin=Point(0, 0, 0))
rotate = Rotate(Geometry=construct_point, Angle=degrees(range), Plane=xy_plane)  # -> Geometry, Transform
unit_z_2 = UnitZ(Factor=range)
panel_4 = Panel(range)
move = Move(Geometry=rotate.Geometry, Motion=unit_z_2)  # -> Geometry, Transform
interpolate = Interpolate(Vertices=rotate.Geometry, Degree=3, Periodic=False, KnotStyle=1)  # -> Curve, Length, Domain

panel_5 = Panel("Length of tread")

# ----
# How many treads before a landing
number_slider_5 = Slider(12, range=0..20)

panel_6 = Panel("Length of landing")

repeat_data = RepeatData(Data=Slider(273, range=0..1000), Length=number_slider_5)
merge = Merge(Data1=flatten(repeat_data), Data2=flatten(Slider(1304, range=0..5000)))  # -> flatten(Result)
repeat_data_2 = RepeatData(Data=merge, Length=Slider(23, range=0..100))
length = Length(Curve=interpolate.Curve)

# ----
# Cumulatively adds the values - see panel
mass_addition = MassAddition(Input=flatten(repeat_data_2))  # -> Result, PartialResults

division_2 = Division(A=mass_addition.PartialResults, B=length)
shatter = Shatter(Curve=reparameterize(interpolate.Curve), Parameters=division_2)
panel_7 = Panel(mass_addition.PartialResults)
cull_index = CullIndex(List=shatter, Indices="-1", Wrap=True)
scale = Scale(Geometry=cull_index, Center=Point(0, 0, 0), Factor=Slider(3, range=0..10))  # -> Geometry, Transform
# Similar to loft, but works like a line
ruled_surface = RuledSurface(CurveA=cull_index, CurveB=scale.Geometry)
list_length = ListLength(List=ruled_surface)
series = Series(Start="150", Step="150", Count=list_length)
unit_z_3 = UnitZ(Factor=series)
panel_8 = Panel(series)
move_2 = Move(Geometry=ruled_surface, Motion=unit_z_3)  # -> Geometry, Transform
