# Grasshopper definition 20240819_Iteration 1.gh (Grasshopper 1.0.8)
# plug-ins: Pufferfish

number_slider = Slider(97, range=0..1000)
circle = Circle(Plane=PlaneXY(0, 0, 0), Radius=number_slider)
addition = Addition(A=number_slider, B=Slider(89, range=0..100))
offset_curve = OffsetCurve(Curve=circle, Distance=addition, Corners=1)
divide_curve = DivideCurve(Curve=offset_curve, Count=Slider(20, range=0..20), Kinks=False)  # -> Points, Tangents, Parameters
dispatch = Dispatch(List=divide_curve.Points, DispatchPattern=[True, False])  # -> ListA, ListB
multiplication = Multiplication(A=number_slider, B=Slider(7, range=0..10))
points_trim_curve = PointsTrimCurve(Curve=offset_curve, Points=divide_curve.Points, Flip="1")  # -> Trimmed, SubDomains, Intersected
line = Line(StartPoint=dispatch.ListA, EndPoint=dispatch.ListB)
end_points = EndPoints(Curve=flatten(line))  # -> Start, End
offset_curve_2 = OffsetCurve(Curve=line, Distance=Slider(100, range=0..100), Corners=1)  # -> flatten(Curve)
end_points_2 = EndPoints(Curve=flatten(offset_curve_2))  # -> Start, End
line_2 = Line(StartPoint=end_points_2.Start, EndPoint=end_points.Start)
line_3 = Line(StartPoint=end_points_2.End, EndPoint=end_points.End)
merge = Merge(Data1=flatten(points_trim_curve.Trimmed), Data2=flatten(offset_curve_2), Data3=flatten(line_3), Data4=flatten(line_2))
number_slider_2 = Slider(1.495, range=0..5)
join_curves = JoinCurves(Curves=merge, Preserve=False)
number = Number(multiplication)
subtraction = Subtraction(A=Slider(0, range=0..1), B=number_slider_2)
rotate = Rotate(Geometry=join_curves, Angle=subtraction, Plane=PlaneXY(0, 0, 0))  # -> Geometry, Transform
rotate_2 = Rotate(Geometry=join_curves, Angle=number_slider_2, Plane=PlaneXY(0, 0, 0))  # -> Geometry, Transform
unit_x = UnitX(Factor=number)
move = Move(Geometry=[circle, rotate.Geometry], Motion=unit_x)  # -> Geometry, Transform
