# Grasshopper definition 20241110_Karamba Testing.gh (Grasshopper 1.0.8)
# plug-ins: Karamba3D

element = ElementKaramba3D()
Z = UnitZ(Factor=1)
multiplication = Multiplication(A=Z, B="-50")
crv = Curve([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])
pt = Point([Point(55.29420852, 33.23567213, 16.68860984), Point(61.34447674, 33.23567213, 16.68860984), Point(58.33708844, 33.23567213, 19.64615193), Point(63.98688612, 33.23567213, 19.64615193), Point(52.39664932, 33.23567213, 19.64615193)])
matselect = MaterialSelectionKaramba3D(NameOrListIndexOfMaterial="S235 # Steel", menu=[dropdown(0), dropdown(0)])
linetobeam = LineToBeamKaramba3D(
    Line=crv,
    New=True,
    Remove=True,
    LimitDistance_m=0.005,
    Bending=True,
    SetBucklingLength=True,
    ToPolylineMaxAngle=0.03,
    ToPolylineTolerance=0.01,
    ToPolylineMaxEdgeLength=0.25)  # -> Element, Points, Info
loads = LoadsKaramba3D(Vector=multiplication, LCase="0", mode="Gravity")
pt_2 = Point([<point referenced from the Rhino model> x2])
crosecselect = CrossSectionSelectorKaramba3D(NameOrListIndexOfCrossSection="CHsH244.5x5.0")  # -> CrossSection, Info
supp = SupportKaramba3D(PosInd=pt_2, menu=[buttons(on, on, on, on, on, on)])
assemble = AssembleModelKaramba3D(
    Point=pt,
    Elem=linetobeam.Element,
    Support=supp,
    Load=loads,
    CrossSection=crosecselect.CrossSection,
    Material=matselect,
    LimitDistance_m=0.005)  # -> Model, Info, Mass_kg, CenterOfGravity, LoadCaseNames
model = ModelKaramba3D(assemble.Model)
analyze = AnalyzeKaramba3D(Model=model)  # -> CalculatedModel, MaximumDisplacement_cm, ResultingForceOfGravity_kN, ElasticEnergyChange_kNm
modelview = ModelViewKaramba3D(Model=analyze.CalculatedModel, ResultFactors=1, ResultCase=-1)  # -> Model, DeformedMesh, DeformedAxes, DeformedModel
beamview = BeamViewKaramba3D(Model=modelview.Model)  # -> Model, MeshesOfRenderedBeams, DeformedBeamAxes, LegendColors, LegendTags
