# Grasshopper definition 20241113_From the PC.gh (Grasshopper 1.0.8)
# plug-ins: Karamba3D

line_to_beam_karamba3d = LineToBeam(
    New=True,
    Remove=True,
    LimitDistance_m=0.005,
    Bending=True,
    SetBucklingLength=True,
    ToPolylineMaxAngle=0.03,
    ToPolylineTolerance=0.01,
    ToPolylineMaxEdgeLength=0.25)  # -> Element, Points, Info
brep = Brep(<brep referenced from the Rhino model>)
curve = Curve([<curve referenced from the Rhino model> x4])
crv = Curve(<curve referenced from the Rhino model>)
unit_z = UnitZ(Factor=1)
point = Point([<point referenced from the Rhino model> x4])
divide = DivideCurve(Curve=crv, Count=Slider(34, range=0..100), Kinks=False)  # -> Points, Tangents, Parameters
mesh_to_shell_karamba3d = MToShell(Mesh=brep, LimitDistance_m=0.005)  # -> Element, Points, Info
support_karamba3d = SupportKaramba3D(PosInd=point, menu=[buttons(off, off, off, off, off, off)])
loads_karamba3d = Loads(Vector=unit_z, LCase="0", mode="Gravity")
line_to_beam_karamba3d_2 = LineToBeam(
    Line=curve,
    New=True,
    Remove=True,
    LimitDistance_m=0.005,
    Bending=True,
    SetBucklingLength=True,
    ToPolylineMaxAngle=0.03,
    ToPolylineTolerance=0.01,
    ToPolylineMaxEdgeLength=0.25)  # -> Element, Points, Info
material_selection_karamba3d = MatSelect(menu=[dropdown(0), dropdown(0)])
cross_section_karamba3d = CroSec(
    FamilyNameOfCrossSection="DefaultCroSec",
    Height_cm=9.6,
    UpperFlangeWidth_cm=10,
    LowerFlangeWidth_cm=10,
    UpperFlangeThickness_cm=0.8,
    LowerFlangeThickness_cm=0.8,
    WebThickness_cm=0.5,
    FilletRadius_cm=0,
    mode="I")
loads_karamba3d_2 = Loads(Vector=Vector(0, 0, -1), LCase="0", mode="Gravity")
element = ElementKaramba3D(mesh_to_shell_karamba3d.Element)
material_selection_karamba3d_2 = MatSelect(menu=[dropdown(0), dropdown(0)])
cross_section_karamba3d_2 = CroSec(
    FamilyNameOfCrossSection="DefaultCroSec",
    Height_cm=9.6,
    UpperFlangeWidth_cm=10,
    LowerFlangeWidth_cm=10,
    UpperFlangeThickness_cm=0.8,
    LowerFlangeThickness_cm=0.8,
    WebThickness_cm=0.5,
    FilletRadius_cm=0,
    mode="I")
assemble_model_karamba3d = Assemble(
    Elem=element,
    Load=loads_karamba3d_2,
    CrossSection=cross_section_karamba3d,
    Material=material_selection_karamba3d,
    LimitDistance_m=0.005)  # -> Model, Info, Mass_kg, CentreOfGravity, LoadCaseNames
element_2 = ElementKaramba3D(line_to_beam_karamba3d_2.Element)
assemble_model_karamba3d_2 = Assemble(
    Elem=element_2,
    Support=support_karamba3d,
    Load=loads_karamba3d,
    CrossSection=cross_section_karamba3d_2,
    Material=material_selection_karamba3d_2,
    LimitDistance_m=0.005)  # -> Model, Info, Mass_kg, CentreOfGravity, LoadCaseNames
analyze_karamba3d = Analyze(Model=assemble_model_karamba3d.Model)  # -> CalculatedModel, MaximumDisplacement_cm, ResultingForceOfGravity_kN, ElasticEnergyChange_kNm
analyze_karamba3d_2 = Analyze(Model=assemble_model_karamba3d_2.Model)  # -> CalculatedModel, MaximumDisplacement_cm, ResultingForceOfGravity_kN, ElasticEnergyChange_kNm
