# Grasshopper definition 20241113_Karamba 3D Testing_Concrete Dome.gh (Grasshopper 1.0.8)
# plug-ins: Karamba3D

unit_z = UnitZ(Factor=1)
multiplication = Multiplication(A=unit_z, B="-1")
point = Point([<point referenced from the Rhino model> x3])
curve = Curve([<curve referenced from the Rhino model> x12])
support_karamba3d = Supp(PosInd=point, menu=[buttons(on, on, on, on, on, on)])
loads_karamba3d = Loads(Vector=multiplication, LCase="0", mode="Gravity")
line_to_beam_karamba3d = LineToBeam(
    Line=curve,
    New=True,
    Remove=True,
    LimitDistance_m=0.005,
    Bending=True,
    SetBucklingLength=True,
    ToPolylineMaxAngle=0.03,
    ToPolylineTolerance=0.01,
    ToPolylineMaxEdgeLength=0.25)  # -> Element, Points, Info
point_2 = Point(<point referenced from the Rhino model>)
material_selection_karamba3d = MatSelect(menu=[dropdown(0), dropdown(0)])
element = ElementKaramba3D(line_to_beam_karamba3d.Element)
cross_section_karamba3d = CroSec(
    FamilyNameOfCrossSection="DefaultCroSec",
    Diameter_cm=Slider(100, range=0..100),
    WallThickness_cm=0.4,
    mode="Circular Hollow")
assemble_model_karamba3d = Assemble(
    Point=point_2,
    Elem=element,
    Support=support_karamba3d,
    Load=loads_karamba3d,
    CrossSection=cross_section_karamba3d,
    Material=material_selection_karamba3d,
    LimitDistance_m=0.005)  # -> Model, Info, Mass_kg, CentreOfGravity, LoadCaseNames
eigen_modes_karamba3d = EModes(
    Model=assemble_model_karamba3d.Model,
    FromIndex=1,
    NumberOfModes=1,
    WithThIIEffects=True,
    MaximumNumberOfIterations=300,
    Epsilon=1e-07)  # -> ModelWithEigenModes, Eigenvalues
connected_parts_karamba3d = ConParts(Model=assemble_model_karamba3d.Model)  # -> ConnectedLines, ConnectedMeshes
analyze_karamba3d = Analyze(Model=assemble_model_karamba3d.Model)  # -> CalculatedModel, MaximumDisplacement_cm, ResultingForceOfGravity_kN, ElasticEnergyChange_kNm
panel = Panel(eigen_modes_karamba3d.ModelWithEigenModes)
param_viewer = ParamViewer(connected_parts_karamba3d.ConnectedLines)
connected_parts_karamba3d_2 = ConParts(Model=assemble_model_karamba3d.Model)  # -> ConnectedLines, ConnectedMeshes
model_view_karamba3d = ModelView(Model=analyze_karamba3d.CalculatedModel, DeformationDirection=2)  # -> Model, DeformedMesh, DeformedAxes, DeformedModel, MaximumDeformation
beam_view_karamba3d = BeamView(Model=model_view_karamba3d.Model)  # -> Model, MeshesOfRenderedBeams, DeformedBeamAxes, LegendColours, LegendTags
